# Dynamo graph DisenoVial_AutomatizacionCompleta.dyn (Dynamo 3.5.2.8914)
# Automatizacion diseno vial Civil 3D 2026

capa_eje_de_camino = StringInput("EJE DE CAMINO")
nombre_alineamiento = StringInput("ALI-EJE")
paso_1_crear_alineamiento = Python(IN[0]=capa_eje_de_camino, IN[1]=nombre_alineamiento)  # IronPython2
# ---------- paso_1_crear_alineamiento.python (144 lines) ----------
# PASO 1: UN alineamiento por CADA polilinea del modelo (sin filtrar)
# API correcta: Alignment.Create(doc, polylineId, name, ...) -- NO existe CreateFromPolyline.
# Fallback manual: AddFixedLine + AddFixedCurve(3 puntos) -- NO existe AddFixedArc.
# Llamadas a Create* fuera de transaccion abierta (la API abre la suya interna).
# OUT = [ [alignment_id, ...], [log...] ]
import clr, math
clr.AddReference('AcMgd'); clr.AddReference('AcDbMgd'); clr.AddReference('AeccDbMgd')
from Autodesk.AutoCAD.ApplicationServices import Application
from Autodesk.AutoCAD.DatabaseServices import *
from Autodesk.AutoCAD.Geometry import Point3d
from Autodesk.Civil.ApplicationServices import CivilApplication
from Autodesk.Civil.DatabaseServices import Alignment

layer_name = IN[0]   # conservado por compatibilidad; no filtra
ali_base   = IN[1]
DEST_LAYER = 'C-ROAD-CNTR'
doc  = Application.DocumentManager.MdiActiveDocument
db   = doc.Database
cdoc = CivilApplication.ActiveDocument
logs = []

def sty(col, *ns):
    for n in ns:
        try: return col[n]
        except: pass
    for s in col: return s
    return ObjectId.Null

def ensure_layer(name):
    with doc.LockDocument():
        with db.TransactionManager.StartTransaction() as tr:
            lt = tr.GetObject(db.LayerTableId, OpenMode.ForRead)
            if lt.Has(name):
                lid = lt[name]; tr.Commit(); return lid
            lt.UpgradeOpen()
            ltr = LayerTableRecord(); ltr.Name = name
            lid = lt.Add(ltr); tr.AddNewlyCreatedDBObject(ltr, True)
            tr.Commit(); return lid

def delete_alignment(name):
    with doc.LockDocument():
        with db.TransactionManager.StartTransaction() as tr:
            for aid in cdoc.GetAlignmentIds():
                a = tr.GetObject(aid, OpenMode.ForRead)
                if a.Name.upper() == name.upper():
                    a.UpgradeOpen(); a.Erase(); tr.Commit(); return
            tr.Commit()

def read_pline(pid):
    segs = []
    with doc.LockDocument():
        with db.TransactionManager.StartTransaction() as tr:
            pl = tr.GetObject(pid, OpenMode.ForRead)
            nv = pl.NumberOfVertices
            rng = range(nv) if pl.Closed else range(nv - 1)
            for i in rng:
                j = (i + 1) % nv
                p1 = pl.GetPoint3dAt(i); p2 = pl.GetPoint3dAt(j)
                segs.append((p1.X, p1.Y, p2.X, p2.Y, pl.GetBulgeAt(i)))
            tr.Commit()
    return segs

def create_from_pline(pid, name, lid, ast, lst):
    # Prueba varias firmas del overload con polilinea segun version de Civil 3D.
    errs = []
    sigs = [
        lambda: Alignment.Create(cdoc, pid, name, ObjectId.Null, lid, ast, lst, False, False),
        lambda: Alignment.Create(cdoc, pid, name, ObjectId.Null, lid, ast, lst),
    ]
    for f in sigs:
        try:
            with doc.LockDocument():
                return f(), None
        except Exception as e:
            errs.append(str(e))
    return None, ' | '.join(errs)

def build_manual(pid, name, lid, ast, lst):
    segs = read_pline(pid)
    with doc.LockDocument():
        aid = Alignment.Create(cdoc, name, ObjectId.Null, lid, ast, lst)
    with doc.LockDocument():
        with db.TransactionManager.StartTransaction() as tr:
            ents = tr.GetObject(aid, OpenMode.ForWrite).Entities
            for x1,y1,x2,y2,bv in segs:
                pa = Point3d(x1,y1,0.0); pb = Point3d(x2,y2,0.0)
                if abs(bv) < 1e-12:
                    ents.AddFixedLine(pa, pb)
                else:
                    # punto sobre el arco a la mitad de la cuerda (sagita = cuerda/2 * bulge)
                    mx = (x1+x2)/2.0 - (y2-y1)*bv/2.0
                    my = (y1+y2)/2.0 + (x2-x1)*bv/2.0
                    ents.AddFixedCurve(pa, Point3d(mx,my,0.0), pb)
            tr.Commit()
    return aid

try:
    plines = []
    with doc.LockDocument():
        with db.TransactionManager.StartTransaction() as tr:
            bt  = tr.GetObject(db.BlockTableId, OpenMode.ForRead)
            btr = tr.GetObject(bt[BlockTableRecord.ModelSpace], OpenMode.ForRead)
            for oid in btr:
                obj = tr.GetObject(oid, OpenMode.ForRead)
                if isinstance(obj, (Polyline, Polyline2d, Polyline3d)):
                    plines.append(oid)
            tr.Commit()

    if not plines:
        OUT = [[], [u'[ERROR P1] No hay ninguna polilinea en el modelo.']]
    else:
        logs.append(u'[INFO P1] Polilineas encontradas: ' + str(len(plines)))
        ast = sty(cdoc.Styles.AlignmentStyles, 'Standard', u'Est\xe1ndar', 'Estandar')
        lst = sty(cdoc.Styles.LabelSetStyles.AlignmentLabelSetStyles, 'Standard', '_No Labels')
        lid = ensure_layer(DEST_LAYER)
        aids = []
        one = len(plines) == 1
        for k, pid in enumerate(plines):
            name = ali_base if one else (ali_base + u'-%02d' % (k + 1))
            try:
                delete_alignment(name)
            except Exception as de:
                logs.append(u'[WARN P1] Borrado previo: ' + str(de))
            # Intento 1: overload con polilinea (maneja arcos nativamente)
            aid, err = create_from_pline(pid, name, lid, ast, lst)
            if aid is not None:
                aids.append(aid)
                logs.append(u'[OK P1] ' + name + u' creado (polilinea).')
                continue
            logs.append(u'[WARN P1] Create(polilinea) ' + name + u': ' + err)
            # Intento 2: construccion manual
            try:
                aid = build_manual(pid, name, lid, ast, lst)
                aids.append(aid)
                logs.append(u'[OK P1] ' + name + u' creado (manual).')
            except Exception as e2:
                logs.append(u'[WARN P1] Manual(' + name + u'): ' + str(e2))
        if not aids:
            logs.append(u'[ERROR P1] Ninguna polilinea pudo convertirse en alineamiento.')
        else:
            logs.append(u'[INFO P1] Alineamientos creados: ' + str(len(aids)))
        OUT = [aids, logs]
except Exception as ex:
    OUT = [[], logs + [u'[ERROR P1] Global: ' + str(ex)]]
# ----------------------------------------
nombre_rasante = StringInput("RASANTE")
nombre_assembly = StringInput("camino")
nombre_superficie_tn = StringInput("TN")
nombre_superficie_sello = StringInput("SELLO")
delta_metros = DoubleInput(0.3)
paso_2_crear_sello = Python(IN[0]=nombre_superficie_tn, IN[1]=nombre_superficie_sello, IN[2]=delta_metros, IN[3]=paso_1_crear_alineamiento)  # IronPython2
# ---------- paso_2_crear_sello.python (64 lines) ----------
# PASO 2: SELLO = TN - delta
# IN[0]=tn IN[1]=sello IN[2]=delta IN[3]=salida_P1 [aid,[logs]]
# OUT = [sello_id, tn_id, logs_acumulados]
import clr
clr.AddReference('AcMgd'); clr.AddReference('AcDbMgd'); clr.AddReference('AeccDbMgd')
from Autodesk.AutoCAD.ApplicationServices import Application
from Autodesk.AutoCAD.DatabaseServices import *
from Autodesk.AutoCAD.Geometry import Point3d, Point3dCollection
from Autodesk.Civil.ApplicationServices import CivilApplication
from Autodesk.Civil.DatabaseServices import TinSurface

tn_name    = IN[0]
sello_name = IN[1]
delta      = float(IN[2])
p1 = IN[3]
logs = list(p1[1]) if (p1 and len(p1) > 1 and p1[1]) else []
doc  = Application.DocumentManager.MdiActiveDocument
db   = doc.Database
cdoc = CivilApplication.ActiveDocument

def find_surf(name):
    for sid in cdoc.GetSurfaceIds():
        with db.TransactionManager.StartTransaction() as tr:
            s = tr.GetObject(sid, OpenMode.ForRead); tr.Commit()
            if s.Name.upper() == name.upper(): return sid
    return None

def sty(col, *ns):
    for n in ns:
        try: return col[n]
        except: pass
    for s in col: return s
    return ObjectId.Null

try:
    if not p1 or not p1[0]:
        OUT = [None, None, logs + [u'[SKIP P2] PASO 1 sin alineamiento.']]
    else:
        tn_id = find_surf(tn_name)
        if tn_id is None:
            raise ValueError(u'Superficie TN no encontrada: ' + tn_name)
        ex = find_surf(sello_name)
        if ex is not None:
            with doc.LockDocument():
                with db.TransactionManager.StartTransaction() as tr:
                    tr.GetObject(ex, OpenMode.ForWrite).Erase(); tr.Commit()
        st = sty(cdoc.Styles.SurfaceStyles, 'Standard', u'Est\xe1ndar', 'Estandar')
        with doc.LockDocument():
            with db.TransactionManager.StartTransaction() as tr:
                tn  = tr.GetObject(tn_id, OpenMode.ForRead)
                pts = Point3dCollection()
                for v in tn.Vertices:
                    L = v.Location
                    pts.Add(Point3d(L.X, L.Y, L.Z - delta))
                sid = TinSurface.Create(cdoc, sello_name)
                srf = tr.GetObject(sid, OpenMode.ForWrite)
                if st != ObjectId.Null: srf.StyleId = st
                srf.AddVertices(pts)
                srf.Rebuild()
                tr.Commit()
        logs.append(u'[OK P2] SELLO = TN - %.3f m (%d vert.)' % (delta, pts.Count))
        OUT = [sid, tn_id, logs]
except Exception as ex:
    OUT = [None, None, logs + [u'[ERROR P2] ' + str(ex)]]
# ----------------------------------------
paso_3_vista_de_perfil = Python(IN[0]=paso_1_crear_alineamiento, IN[1]=paso_2_crear_sello)  # IronPython2
# ---------- paso_3_vista_de_perfil.python (66 lines) ----------
# PASO 3: una vista de perfil (TN + SELLO) por CADA alineamiento
# IN[0]=salida_P1 [aids,logs]  IN[1]=salida_P2 [sello,tn,logs]
# OUT = [ [pv_id,...], logs_acumulados ]
import clr
clr.AddReference('AcMgd'); clr.AddReference('AcDbMgd'); clr.AddReference('AeccDbMgd')
from Autodesk.AutoCAD.ApplicationServices import Application
from Autodesk.AutoCAD.DatabaseServices import *
from Autodesk.AutoCAD.Geometry import Point3d
from Autodesk.Civil.ApplicationServices import CivilApplication
from Autodesk.Civil.DatabaseServices import Profile, ProfileView

p1 = IN[0]; p2 = IN[1]
logs = list(p2[2]) if (p2 and len(p2) > 2 and p2[2]) else []
doc  = Application.DocumentManager.MdiActiveDocument
db   = doc.Database
cdoc = CivilApplication.ActiveDocument

def sty(col, *ns):
    for n in ns:
        try: return col[n]
        except: pass
    for s in col: return s
    return ObjectId.Null

def surf_profile(tr, ali_id, surf_id, name, lay):
    ali = tr.GetObject(ali_id, OpenMode.ForRead)
    for pid in ali.GetProfileIds():
        if tr.GetObject(pid, OpenMode.ForRead).Name == name:
            return pid
    ps = sty(cdoc.Styles.ProfileStyles, 'Standard', u'Est\xe1ndar', 'Estandar')
    ls = sty(cdoc.Styles.LabelSetStyles.ProfileLabelSetStyles, '_No Labels', 'Standard')
    return Profile.CreateFromSurface(name, ali_id, surf_id, lay, ps, ls)

try:
    aids = p1[0] if (p1 and p1[0]) else []
    if not aids:
        OUT = [[], logs + [u'[SKIP P3] PASO 1 sin alineamientos.']]
    elif not p2 or p2[0] is None:
        OUT = [[], logs + [u'[SKIP P3] PASO 2 sin SELLO.']]
    else:
        sello_id = p2[0]; tn_id = p2[1]
        pvs = sty(cdoc.Styles.ProfileViewStyles, 'Standard', u'Est\xe1ndar', 'Estandar')
        pv_ids = []
        with doc.LockDocument():
            with db.TransactionManager.StartTransaction() as tr:
                cl = db.Clayer
                for k, aid in enumerate(aids):
                    try:
                        ali = tr.GetObject(aid, OpenMode.ForRead)
                        nm  = ali.Name
                        ext = ali.GeometricExtents
                        ins = Point3d(ext.MaxPoint.X + 150.0,
                                      ext.MinPoint.Y - k * 250.0, 0.0)
                        surf_profile(tr, aid, tn_id,    u'PERF-TN-'+nm,    cl)
                        surf_profile(tr, aid, sello_id, u'PERF-SELLO-'+nm, cl)
                        pv = tr.GetObject(ProfileView.Create(aid, ins), OpenMode.ForWrite)
                        pv.Name = u'PV-' + nm
                        if pvs != ObjectId.Null: pv.StyleId = pvs
                        pv_ids.append(pv.ObjectId)
                    except Exception as e:
                        logs.append(u'[WARN P3] vista omitida: ' + str(e))
                tr.Commit()
        logs.append(u'[OK P3] Vistas de perfil creadas: ' + str(len(pv_ids)))
        OUT = [pv_ids, logs]
except Exception as ex:
    OUT = [[], logs + [u'[ERROR P3] ' + str(ex)]]
# ----------------------------------------
paso_4_crear_corredor = Python(IN[0]=paso_1_crear_alineamiento, IN[1]=nombre_rasante, IN[2]=nombre_assembly, IN[3]=paso_2_crear_sello, IN[4]=paso_3_vista_de_perfil)  # IronPython2
# ---------- paso_4_crear_corredor.python (84 lines) ----------
# PASO 4: un corredor por CADA alineamiento que tenga rasante
# IN[0]=salida_P1 IN[1]=rasante IN[2]=assembly IN[3]=salida_P2 IN[4]=salida_P3
# La rasante se busca por nombre dentro de cada alineamiento (no se genera).
# OUT = [ [corridor_id,...], logs_acumulados ]
import clr
clr.AddReference('AcMgd'); clr.AddReference('AcDbMgd'); clr.AddReference('AeccDbMgd')
from Autodesk.AutoCAD.ApplicationServices import Application
from Autodesk.AutoCAD.DatabaseServices import *
from Autodesk.Civil.ApplicationServices import CivilApplication
from Autodesk.Civil.DatabaseServices import Corridor

p1 = IN[0]; profile_name = IN[1]; assembly_name = IN[2]
p2 = IN[3]; p3 = IN[4]
logs = list(p3[1]) if (p3 and len(p3) > 1 and p3[1]) else []
doc  = Application.DocumentManager.MdiActiveDocument
db   = doc.Database
cdoc = CivilApplication.ActiveDocument

def sty(col, *ns):
    for n in ns:
        try: return col[n]
        except: pass
    for s in col: return s
    return ObjectId.Null

def find_profile(tr, ali_id, name):
    ali = tr.GetObject(ali_id, OpenMode.ForRead)
    for pid in ali.GetProfileIds():
        if tr.GetObject(pid, OpenMode.ForRead).Name.upper() == name.upper():
            return pid
    return None

def find_assembly(name):
    import unicodedata
    def n(s):
        return ''.join(c for c in unicodedata.normalize('NFD', unicode(s))
                       if unicodedata.category(c) != 'Mn').upper()
    tgt = n(name)
    with db.TransactionManager.StartTransaction() as tr:
        for aid in cdoc.GetAssemblyIds():
            if n(tr.GetObject(aid, OpenMode.ForRead).Name) == tgt:
                tr.Commit(); return aid
        tr.Commit()
    return None

try:
    aids = p1[0] if (p1 and p1[0]) else []
    if not aids:
        OUT = [[], logs + [u'[SKIP P4] PASO 1 sin alineamientos.']]
    elif not p3 or not p3[0]:
        OUT = [[], logs + [u'[SKIP P4] PASO 3 sin vistas de perfil.']]
    else:
        asm_id = find_assembly(assembly_name)
        if asm_id is None:
            raise ValueError(u'Assembly no encontrado: ' + assembly_name)
        cst = sty(cdoc.Styles.CorridorStyles, 'Standard', u'Est\xe1ndar', 'Estandar')
        cor_ids = []
        with doc.LockDocument():
            with db.TransactionManager.StartTransaction() as tr:
                for aid in aids:
                    ali = tr.GetObject(aid, OpenMode.ForRead)
                    nm  = ali.Name
                    pr  = find_profile(tr, aid, profile_name)
                    if pr is None:
                        logs.append(u'[WARN P4] ' + nm +
                                    u': sin rasante "' + profile_name + u'", omitido.')
                        continue
                    s0, s1 = ali.StartingStation, ali.EndingStation
                    cor = tr.GetObject(Corridor.Create(cdoc, u'COR-'+nm), OpenMode.ForWrite)
                    if cst != ObjectId.Null: cor.StyleId = cst
                    bl  = cor.Baselines.Add(u'BL-'+nm, aid, pr)
                    reg = bl.BaselineRegions.Add(u'REG-1', asm_id)
                    try:
                        reg.StartStation = s0; reg.EndStation = s1
                    except: pass
                    cor.Rebuild()
                    cor_ids.append(cor.ObjectId)
                    logs.append(u'[OK P4] Corredor COR-' + nm + u' creado.')
                tr.Commit()
        logs.append(u'[INFO P4] Corredores creados: ' + str(len(cor_ids)) +
                    u' de ' + str(len(aids)) + u' alineamientos.')
        OUT = [cor_ids, logs]
except Exception as ex:
    OUT = [[], logs + [u'[ERROR P4] ' + str(ex)]]
# ----------------------------------------
watch_resultado = Watch(paso_4_crear_corredor)
